# Grasshopper definition FacadeEmbed_JinQiao_Podium.gh (Grasshopper 1.0.7)
# plug-ins: EleFront, Wombat, Hare, Pufferfish, TT Toolbox

# ---- group: 钢结构预埋
crv = Curve([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])

# ---- group: 板槽
inblock = InsertBlock(BlockName="xxx", SourcePlane=PlaneXY(0, 0, 0))

# ----
# 单体选型
list = ValueList({"板埋": 0, "槽埋": 1, "板槽埋": 2}, selected="槽埋")
list_2 = ValueList({"顶埋": 0, "侧埋": 1}, selected="顶埋")
panel = Panel(list)
panel_2 = Panel(list_2)

# ----
# 1.输入block names
data = Data(["PX-GLAZ-F2$0$PX-GLAZ-F2$0$fin", "PX-GLAZ-F2$0$PX-GLAZ-F1$0$fin"])
panel_3 = Panel(data)

# ----
# Prep
# 区分有Plane 和 无Plane的 Block
# block names
listblockd = ListBlockDocument()
panel_5 = Panel(listblockd)
refblock = ReferenceBlockByName(BlockName=panel_3)
deblock = DeconstructBlock(Block=refblock)  # -> Name, Plane, Geometry

# ----
# 找到定位的Block&Curve
# 完成后逐个按Update按钮
# block names
# Later:
# 处理定位点不是Block的情况
# 以及定位点是Blcok、Curves与建筑线不同组合可能
listblockd_2 = ListBlockDocument()
panel_6 = Panel(listblockd_2)

# ----
# Input Blocks (have Plan)
# 主体定位点
data_2 = Data(["PX-GLAZ-F2$0$PX-GLAZ-F1$0$标准块", "PX-GLAZ-F2$0$PX-GLAZ-F2$0$标准块", "PX-GLAZ-F2$0$PX-GLAZ-F3$0$标准块", "PX-GLAZ-F2$0$T3T"])

# ----
# Input Blocks转换的Curves
# 主体定位点
crv_2 = Curve(<curve referenced from the Rhino model>)

# ---- group: 结构线
crv_3 = Curve(<curve referenced from the Rhino model>)

# ----
# 平面定位INPUT
crv_4 = Curve([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])

# ---- group: 玻璃线
玻璃线 = Curve(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)
玻璃线_2 = Curve(<curve referenced from the Rhino model>)
玻璃线_3 = Curve(<curve referenced from the Rhino model>)

# ---- group: 定位竖料
crv_5 = Curve([<curve referenced from the Rhino model> x300])
crv_6 = Curve([<curve referenced from the Rhino model> x180])
crv_7 = Curve([<curve referenced from the Rhino model> x383])

# ----
# Input Curve
# 2层时内部定位点
crv_8 = Curve(<curve referenced from the Rhino model>)

# ----
# 按图层整理curves
# 完成后逐个按Update按钮
panel_7 = Panel("Arch_curve_smooth")
reflay = ReferenceByLayer(LayerName=panel_7)
reflay_2 = ReferenceByLayer(LayerName="Arch_curve_doubleLine")
reflay_3 = ReferenceByLayer(LayerName="Arch_curve_angular_withLocation")
reflay_4 = ReferenceByLayer(LayerName="Arch_curve_angular")
reflay_5 = ReferenceByLayer(LayerName="ArchCurve_Whole")

# ----
# This Project Only
panel_8 = Panel("Arch_curve_other")
reflay_6 = ReferenceByLayer(LayerName=panel_8)

# ---- group: 混凝土
# 板埋几何INPUT
list_3 = ValueList({"C15": 0, "C20": 1, "C25": 2, "C30": 3, "C35": 4, "C40": 5}, selected="C35")

# ---- group: 钢筋牌号
list_4 = ValueList({"HPB300": 0, "HRB400": 1}, selected="HPB300")

# ---- group: 直径
list_5 = ValueList({"10": 0, "12": 1, "16": 2, "18": 3, "20": 4, "25": 5}, selected="12")

# ---- group: 列
list_6 = ValueList({"2X": 0, "3X": 1, "4X": 2}, selected="3X")

# ---- group: 行
list_7 = ValueList({"2Y": 0, "3Y": 1, "4Y": 2}, selected="2Y")

# ---- group: 锚筋间距
s_x = Slider(22, range=14..60, expression="X*5")
s_y = Slider(22, range=14..60, expression="X*5")

# ----
crv_9 = Curve([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])

layer = ObjectLayer(Guid=crv_8)  # -> LayerIndex, LayerPathName
panel_9 = Panel(layer.LayerPathName)
reflay_7 = ReferenceByLayer(LayerName=panel_9)
xy = XYPlane(Origin=Point(0, 0, 0))
project = Project(Geometry=reflay_7, Plane=xy)  # -> Geometry, Transform

panel_10 = Panel(data_2)
layer_2 = ObjectLayer(Guid=crv_2)  # -> LayerIndex, LayerPathName
panel_12 = Panel(layer_2.LayerPathName)
reflay_8 = ReferenceByLayer(LayerName=panel_12)
refblock_2 = ReferenceBlockByName(BlockName=panel_10)
xy_2 = XYPlane(Origin=Point(0, 0, 0))
xy_3 = XYPlane(Origin=Point(0, 0, 0))
project_2 = Project(Geometry=reflay_8, Plane=xy_2)  # -> Geometry, Transform
project_3 = Project(Geometry=refblock_2, Plane=xy_3)  # -> Geometry, Transform

# ----
# 槽埋-角部选择
list_8 = ValueList({"槽埋角部-L形": 0, "槽埋角部-I形": 1}, selected="槽埋角部-I形")

join = JoinCurves(Curves=crv_9, Preserve=False)
xy_4 = XYPlane(Origin=Point(0, 0, 0))
xy_5 = XYPlane(Origin=Point(0, 0, 0))
xy_6 = XYPlane(Origin=Point(0, 0, 0))
xy_7 = XYPlane(Origin=Point(0, 0, 0))
xy_8 = XYPlane(Origin=Point(0, 0, 0))
xy_9 = XYPlane(Origin=Point(0, 0, 0))
flip = FlipCurve(Curve=玻璃线)  # -> Curve, Flag
boundary = BoundarySurfaces(Edges=join)
project_4 = Project(Geometry=reflay, Plane=xy_4)  # -> Geometry, Transform
project_5 = Project(Geometry=reflay_2, Plane=xy_5)  # -> Geometry, Transform
project_6 = Project(Geometry=reflay_3, Plane=xy_6)  # -> Geometry, Transform
project_7 = Project(Geometry=reflay_4, Plane=xy_7)  # -> Geometry, Transform
project_8 = Project(Geometry=reflay_5, Plane=xy_8)  # -> Geometry, Transform
project_9 = Project(Geometry=reflay_6, Plane=xy_9)  # -> Geometry, Transform

# ----
# 2.检测plane是否存在
pln = Plane(deblock.Plane)

filter = StreamFilter(Gate=Toggle(True), Stream0=玻璃线, Stream1=flip.Curve)
sunion = SolidUnion(Breps=boundary)
crv_10 = Curve(project_5.Geometry)
crv_11 = Curve(project_6.Geometry)
crv_12 = Curve(project_4.Geometry)
crv_13 = Curve(project_7.Geometry)
crv_14 = Curve(project_8.Geometry)
offset = OffsetCurve(Curve=filter, Distance=expr("-x", Slider(375, range=0..1000)), Corners=1)
area = Area(Geometry=sunion)  # -> Area, Centroid

# ----
# 3.如果不存在则Blake geometry
# 并在rhino里面清理线段
geo = Geometry(deblock.Geometry)

pt = Point(area.Centroid)
explode = Explode(Curve=offset, Recursive=True)  # -> Segments, Vertices

# ---- group: 钢结构预埋
# 随文件数据请勿覆盖
crv_15 = Curve([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])

# ---- group: 槽埋3D
brep = Brep(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)

# ----
pt_2 = Point(explode.Vertices)
entwine = Entwine(Branch00=sunion, Branch01=pt, FlattenInputs=True)
max = Maximum(A=s_x, B=s_y)
flip_2 = FlipMatrix(Data=entwine)
filter_2 = StreamFilter(Gate=list_3, Stream0=7.2, Stream1=9.6, Stream2=11.9, Stream3=14.3, Stream4=16.7, Stream5=19.1)
filter_3 = StreamFilter(Gate=list_4, Stream0=270, Stream1=360)
filter_4 = StreamFilter(Gate=list_5, Stream0=10, Stream1=12, Stream2=16, Stream3=18, Stream4=20, Stream5=25)
filter_5 = StreamFilter(Gate=list_3, Stream0=0.91, Stream1=1.1, Stream2=1.27, Stream3=1.43, Stream4=1.57, Stream5=1.71)
filter_6 = StreamFilter(Gate=list_4, Stream0=0.16, Stream1=0.14)
addition = Addition(A=list_6, B=1)
addition_2 = Addition(A=list_7, B=1)
division = Division(A=max, B=8)

# ---- group: 建筑定位轮廓
item = ListItem(List=flip_2, Index="0", Wrap=True)  # -> flatten(Item)

# ---- group: 埋件定位点
item_2 = ListItem(List=flip_2, Index="-1", Wrap=True)  # -> flatten(Item)

# ----
t = Integer(division)

# ----
# 测试Smooth Curve是否与每个Block相切
# remove duplicate blocks
deblock_2 = DeconstructBlock(Block=project_3.Geometry)  # -> Name, Plane, Geometry
pln_2 = Plane(flatten(deblock_2.Plane))
deplane = DeconstructPlane(Plane=pln_2)  # -> Origin, XAxis, YAxis, ZAxis
cullduppoints = RemoveDuplicatePoints(InputPoints=deplane.Origin, Tolerance=0.001)  # -> OutputPoints, FirstPointIndexes
null = NullItem(Item=cullduppoints.FirstPointIndexes)  # -> NullFlags, InvalidFlags, Description
dispatch = Dispatch(List=pln_2, DispatchPattern=null.InvalidFlags)  # -> ListA, ListB
dispatch_2 = Dispatch(List=flatten(project_3.Geometry), DispatchPattern=null.InvalidFlags)  # -> ListA, ListB
pln_3 = Plane(dispatch.ListA)

panel_13 = Panel(filter_5)
panel_14 = Panel(filter_2)
panel_15 = Panel(filter_6)
min = Minimum(A=filter_3, B=300)
brep_2 = Brep(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)
panel_16 = Panel(min)
expression = Expression(A=filter_6, fy=filter_3, ft=filter_5, d=filter_4, Expression="(int((0.6*1.1*A*fy/ft*d)/5)+1)*5")

deblock_3 = DeconstructBlock(Block=dispatch_2.ListA)  # -> Name, Plane, Geometry
data_3 = Data(dispatch_2.ListA)

data_4 = Data(flatten(pln_3))
deplane_2 = DeconstructPlane(Plane=data_4)  # -> Origin, XAxis, YAxis, ZAxis
pln_4 = Plane(data_4)
amp = Amplitude(Vector=deplane_2.YAxis, Amplitude=Slider(300, range=0..1000))
move = Move(Geometry=deplane_2.Origin, Motion=amp)  # -> Geometry, Transform
ln = Line(StartPoint=deplane_2.Origin, EndPoint=move.Geometry)
crv_16 = Curve(crv_12)
midpt = CurveMiddle(Curve=ln)
scale = Scale(Geometry=ln, Center=midpt, Factor=Slider(7.8, range=0..10))  # -> Geometry, Transform
merge = Merge(Data1=scale.Geometry, Data2=crv_16)
mcx = MultipleCurves(Curves=flatten(merge))  # -> Points, IndexA, IndexB, ParamA, ParamB

# ----
# 导入槽埋模型
brep_3 = Brep(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)

# ---- group: 槽埋
# 槽埋Modeling
brep_4 = Brep(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)
bbox = BoundingBox(Content=brep_3, Plane=PlaneXY(0, 0, 0))  # -> Box, Box_2
debox = DeconstructBox(Box=bbox.Box)  # -> Plane, X, Y, Z
area_2 = Area(Geometry=brep_3)  # -> Area, Centroid
pdecon = Deconstruct(Point=area_2.Centroid)  # -> XComponent, YComponent, ZComponent
dedomain = DeconstructDomain(Domain=debox.Z)  # -> Start, End
xy_10 = XYPlane(Origin=Point(0, 0, 0))
pt_3 = ConstructPoint(XCoordinate=pdecon.XComponent, YCoordinate=pdecon.YComponent, ZCoordinate=dedomain.End)
pl_origin = PlaneOrigin(Base=xy_10, Origin=pt_3)
xy_11 = XYPlane(Origin=Point(0, 0, 0))
orient = Orient(Geometry=brep_3, Source=pl_origin, Target=xy_11)  # -> Geometry, Transform

# ----
edges = BrepEdges(Brep=bbox.Box)  # -> Naked, Interior, NonManifold
item_3 = ListItem(List=edges.Interior, Index="5", Wrap=True)
item_4 = ListItem(List=edges.Interior, Index="4", Wrap=True)
clx = CurveLine(Curve=item_4, Line=item_3)  # -> Points, Params, Count
Y = UnitY(Factor=item_3)
rotate = Rotate(Geometry=brep_3, Angle=1.570796327, Plane=clx.Points)  # -> Geometry, Transform
move_2 = Move(Geometry=rotate.Geometry, Motion=Y)  # -> Geometry, Transform
merge_2 = Merge(Data1=brep_3, Data2=move_2.Geometry)  # -> flatten(Result)
sunion_2 = SolidUnion(Breps=merge_2)
bbox_2 = BoundingBox(Content=sunion_2, Plane=PlaneXY(0, 0, 0))  # -> Box, Box_2
area_3 = Area(Geometry=sunion_2)  # -> Area, Centroid
debox_2 = DeconstructBox(Box=bbox_2.Box)  # -> Plane, X, Y, Z
pdecon_2 = Deconstruct(Point=area_3.Centroid)  # -> XComponent, YComponent, ZComponent
dedomain_2 = DeconstructDomain(Domain=debox_2.Z)  # -> Start, End
pt_4 = ConstructPoint(XCoordinate=pdecon_2.XComponent, YCoordinate=pdecon_2.YComponent, ZCoordinate=dedomain_2.End)
xy_12 = XYPlane(Origin=Point(0, 0, 0))
pl_origin_2 = PlaneOrigin(Base=xy_12, Origin=pt_4)
xy_13 = XYPlane(Origin=Point(0, 0, 0))
orient_2 = Orient(Geometry=sunion_2, Source=pl_origin_2, Target=xy_13)  # -> Geometry, Transform

# ----
# blocks + special curves
cull_i = CullIndex(List=flatten(pln_4), Indices=mcx.IndexA, Wrap=True)
cull_i_2 = CullIndex(List=flatten(data_3), Indices=mcx.IndexA, Wrap=True)
pln_5 = Plane(cull_i)
data_5 = Data(cull_i_2)

# ----
# blocks + smooth curves
item_5 = ListItem(List=pln_4, Index=mcx.IndexA, Wrap=True)
item_6 = ListItem(List=flatten(data_3), Index=mcx.IndexA, Wrap=True)
pln_6 = Plane(item_5)
data_6 = Data(item_6)

# ----
# 导入槽埋模型
brep_5 = Brep(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)

# ----
# 第一层
# 
# Special Curves(architecture line)
crv_17 = Curve(crv_11)
pln_7 = Plane(pln_5)
deplane_3 = DeconstructPlane(Plane=pln_7)  # -> Origin, XAxis, YAxis, ZAxis
disc = Discontinuity(Curve=crv_17, Level=1)  # -> Points, Parameters
pull = PullPoint(Point=deplane_3.Origin, Geometry=disc.Points, ClosestOnly=True)  # -> ClosestPoint, Distance
sort = SortList(Keys=pull.Distance)  # -> reverse(Keys), ValuesA
panel_17 = Panel(sort.Keys)
larger = LargerThan(FirstNumber=pull.Distance, SecondNumber=Slider(300, range=0..1000))  # -> LargerThan, OrEqualTo
dispatch_3 = Dispatch(List=pln_7, DispatchPattern=larger.LargerThan)  # -> ListA, ListB
data_7 = Data(dispatch_3.ListB)
deplane_4 = DeconstructPlane(Plane=data_7)  # -> Origin, XAxis, YAxis, ZAxis
pull_2 = PullPoint(Point=deplane_4.Origin, Geometry=disc.Points, ClosestOnly=True)  # -> ClosestPoint, Distance

# ----
# 线段延长长度
number_slider = Slider(1001, range=0..10000)

crv_18 = Curve(project_9.Geometry)

# ----
# remove duplicate curves
geo_2 = Geometry(project_2.Geometry)
boundary_2 = BoundarySurfaces(Edges=geo_2)
area_4 = Area(Geometry=boundary_2)  # -> Area, Centroid
cullduppoints_2 = RemoveDuplicatePoints(InputPoints=area_4.Centroid, Tolerance=Slider(0.1, range=0..0.1))  # -> OutputPoints, FirstPointIndexes
null_2 = NullItem(Item=cullduppoints_2.FirstPointIndexes)  # -> NullFlags, InvalidFlags, Description
dispatch_4 = Dispatch(List=boundary_2, DispatchPattern=null_2.NullFlags)  # -> ListA, ListB
geo_3 = Geometry(dispatch_4.ListA)

# ----
# remove duplicate curves
geo_4 = Geometry(project.Geometry)
boundary_3 = BoundarySurfaces(Edges=geo_4)
area_5 = Area(Geometry=boundary_3)  # -> Area, Centroid
cullduppoints_3 = RemoveDuplicatePoints(InputPoints=area_5.Centroid, Tolerance=Slider(0.1, range=0..0.1))  # -> OutputPoints, FirstPointIndexes
null_3 = NullItem(Item=cullduppoints_3.FirstPointIndexes)  # -> NullFlags, InvalidFlags, Description
dispatch_5 = Dispatch(List=boundary_3, DispatchPattern=null_3.NullFlags)  # -> ListA, ListB
geo_5 = Geometry(dispatch_5.ListA)

# ----
# 调换阴阳角设定
toggle = BooleanToggle(False)

filter_7 = StreamFilter(Gate=list_8, Stream0=orient_2.Geometry, Stream1=orient.Geometry)
crv_19 = Curve(crv_12)
entwine_2 = Entwine(Branch00=orient.Geometry, Branch01=filter_7, FlattenInputs=True)
crv_20 = Curve(crv_12)
crv_21 = Curve(offset)
pl = ConstructPlane(Origin=pull_2.ClosestPoint, XAxis=deplane_4.XAxis, YAxis=deplane_4.YAxis)
crv_22 = Curve([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])
crv_23 = Curve(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)
merge_3 = Merge(Data1=crv_22, Data2=crv_23)

# ---- group: 阴阳角区分
cp = ClosestPoint(Point=pt_2, Cloud=item_2)  # -> ClosestPoint, CPIndex, Distance
item_7 = ListItem(List=item_2, Index=cp.CPIndex, Wrap=True)
crv_cp = CurveClosestPoint(Point=item_7, Curve=offset)  # -> Point, Parameter, Distance
eval = EvaluateCurve(Curve=offset, Parameter=crv_cp.Parameter)  # -> Point, Tangent, Angle

# ----
# 板槽埋Modeling
multiplication = Multiplication(A=s_x, B=addition)
multiplication_2 = Multiplication(A=s_y, B=addition_2)
recgrid = Rectangular(Plane=PlaneXY(0, 0, 0), SizeX=s_x, SizeY=s_y, ExtentX=addition, ExtentY=addition_2)  # -> Cells, Points
直径 = Text(filter_4)
division_2 = Division(A=multiplication, B=2)
division_3 = Division(A=multiplication_2, B=2)
vec = VectorXYZ(XComponent=expr("-x", division_2), YComponent=expr("-x", division_3), ZComponent=0)  # -> Vector, Length
move_3 = Move(Geometry=recgrid.Points, Motion=vec.Vector)  # -> Geometry, Transform
division_4 = Division(A=直径, B=2)
cyl = Cylinder(Base=move_3.Geometry, Radius=division_4, Length=expr("-x", expression))
X = UnitX(Factor=直径)
multiplication_3 = Multiplication(A=直径, B=6)
edges_2 = BrepEdges(Brep=cyl)  # -> Naked, Interior, NonManifold
item_8 = ListItem(List=edges_2.Naked, Index=0, Wrap=True)
max_2 = Maximum(A=multiplication_3, B=70)
move_4 = Move(Geometry=item_8, Motion=X)  # -> Geometry, Transform
multiplication_4 = Multiplication(A=max_2, B=2)
addition_3 = Addition(A=multiplication, B=multiplication_4)
addition_4 = Addition(A=multiplication_2, B=multiplication_4)
division_5 = Division(A=t, B=2)
expression_2 = Expression(x=addition_4, Expression="Ceiling(x/10)*10/2")
expression_3 = Expression(x=addition_3, Expression="Ceiling(x/10)*10/2")
round = Round(Number=division_5)  # -> Nearest, Floor, Ceiling
multiplication_5 = Multiplication(A=round.Ceiling, B=2)
dom = ConstructDomain(DomainStart=expr("-x", expression_2), DomainEnd=expression_2)
dom_2 = ConstructDomain(DomainStart=expr("-x", expression_3), DomainEnd=expression_3)
box = DomainBox(Base=PlaneXY(0, 0, 0), X=dom_2, Y=dom, Z=multiplication_5)
Z = UnitZ(Factor=expr("-x", multiplication_5))

multiplication_6 = Multiplication(A=直径, B=5)

Z_2 = UnitZ(Factor=multiplication_6)
extr = Extrude(Base=move_4.Geometry, Direction=Z_2)
cap = CapHoles(Brep=[extr, cyl])
merge_4 = Merge(Data1=cap, Data2=box)
flatten = FlattenTree(Tree=merge_4, Path="{0}")
move_5 = Move(Geometry=flatten, Motion=Z)  # -> Geometry, Transform

brep_6 = Brep(move_5.Geometry)

# ----
# 槽埋+板埋合并
bbox_3 = BoundingBox(Content=brep_5, Plane=PlaneXY(0, 0, 0))  # -> Box, Box_2
debox_3 = DeconstructBox(Box=bbox_3.Box)  # -> Plane, X, Y, Z
area_6 = Area(Geometry=brep_5)  # -> Area, Centroid
dedomain_3 = DeconstructDomain(Domain=debox_3.Z)  # -> Start, End
pdecon_3 = Deconstruct(Point=area_6.Centroid)  # -> XComponent, YComponent, ZComponent
xy_14 = XYPlane(Origin=Point(0, 0, 0))
pt_5 = ConstructPoint(XCoordinate=pdecon_3.XComponent, YCoordinate=pdecon_3.YComponent, ZCoordinate=dedomain_3.End)
pl_origin_3 = PlaneOrigin(Base=xy_14, Origin=pt_5)
xy_15 = XYPlane(Origin=Point(0, 0, 0))
orient_3 = Orient(Geometry=brep_5, Source=pl_origin_3, Target=xy_15)  # -> Geometry, Transform
bbox_4 = BoundingBox(Content=orient_3.Geometry, Plane=PlaneXY(0, 0, 0))  # -> Box, Box_2
sdiff = SolidDifference(BrepsA=move_5.Geometry, BrepsB=bbox_4.Box)
sunion_3 = SolidUnion(Breps=[sdiff, orient_3.Geometry])  # -> flatten(Result)

edges_3 = BrepEdges(Brep=bbox_3.Box)  # -> Naked, Interior, NonManifold
item_9 = ListItem(List=edges_3.Interior, Index="5", Wrap=True)
item_10 = ListItem(List=edges_3.Interior, Index="4", Wrap=True)
clx_2 = CurveLine(Curve=item_10, Line=item_9)  # -> Points, Params, Count
Y_2 = UnitY(Factor=item_9)
rotate_2 = Rotate(Geometry=brep_5, Angle=1.570796327, Plane=clx_2.Points)  # -> Geometry, Transform
move_6 = Move(Geometry=rotate_2.Geometry, Motion=Y_2)  # -> Geometry, Transform
merge_5 = Merge(Data1=brep_5, Data2=move_6.Geometry)  # -> flatten(Result)
sunion_4 = SolidUnion(Breps=merge_5)
bbox_5 = BoundingBox(Content=sunion_4, Plane=PlaneXY(0, 0, 0))  # -> Box, Box_2
area_7 = Area(Geometry=sunion_4)  # -> Area, Centroid
debox_4 = DeconstructBox(Box=bbox_5.Box)  # -> Plane, X, Y, Z
pdecon_4 = Deconstruct(Point=area_7.Centroid)  # -> XComponent, YComponent, ZComponent
dedomain_4 = DeconstructDomain(Domain=debox_4.Z)  # -> Start, End
pt_6 = ConstructPoint(XCoordinate=pdecon_4.XComponent, YCoordinate=pdecon_4.YComponent, ZCoordinate=dedomain_4.End)
xy_16 = XYPlane(Origin=Point(0, 0, 0))
pl_origin_4 = PlaneOrigin(Base=xy_16, Origin=pt_6)
xy_17 = XYPlane(Origin=Point(0, 0, 0))
orient_4 = Orient(Geometry=sunion_4, Source=pl_origin_4, Target=xy_17)  # -> Geometry, Transform

entwine_3 = Entwine(Branch00=sunion_3, Branch01=orient_4.Geometry, FlattenInputs=True)

# ----
# 板埋Modeling
multiplication_7 = Multiplication(A=s_x, B=addition)
multiplication_8 = Multiplication(A=s_y, B=addition_2)
recgrid_2 = Rectangular(Plane=PlaneXY(0, 0, 0), SizeX=s_x, SizeY=s_y, ExtentX=addition, ExtentY=addition_2)  # -> Cells, Points
直径_2 = Text(filter_4)
division_6 = Division(A=multiplication_7, B=2)
division_7 = Division(A=multiplication_8, B=2)
vec_2 = VectorXYZ(XComponent=expr("-x", division_6), YComponent=expr("-x", division_7), ZComponent=0)  # -> Vector, Length
move_7 = Move(Geometry=recgrid_2.Points, Motion=vec_2.Vector)  # -> Geometry, Transform
division_8 = Division(A=直径_2, B=2)
cyl_2 = Cylinder(Base=move_7.Geometry, Radius=division_8, Length=expr("-x", expression))
X_2 = UnitX(Factor=直径_2)
multiplication_9 = Multiplication(A=直径_2, B=6)
edges_4 = BrepEdges(Brep=cyl_2)  # -> Naked, Interior, NonManifold
item_11 = ListItem(List=edges_4.Naked, Index=0, Wrap=True)
max_3 = Maximum(A=multiplication_9, B=70)
move_8 = Move(Geometry=item_11, Motion=X_2)  # -> Geometry, Transform
multiplication_10 = Multiplication(A=max_3, B=2)
addition_5 = Addition(A=multiplication_7, B=multiplication_10)
addition_6 = Addition(A=multiplication_8, B=multiplication_10)
division_9 = Division(A=t, B=2)
expression_4 = Expression(x=addition_6, Expression="Ceiling(x/10)*10/2")
expression_5 = Expression(x=addition_5, Expression="Ceiling(x/10)*10/2")
round_2 = Round(Number=division_9)  # -> Nearest, Floor, Ceiling
multiplication_11 = Multiplication(A=round_2.Ceiling, B=2)
dom_3 = ConstructDomain(DomainStart=expr("-x", expression_4), DomainEnd=expression_4)
dom_4 = ConstructDomain(DomainStart=expr("-x", expression_5), DomainEnd=expression_5)
box_2 = DomainBox(Base=PlaneXY(0, 0, 0), X=dom_4, Y=dom_3, Z=multiplication_11)
Z_3 = UnitZ(Factor=expr("-x", multiplication_11))
move_9 = Move(Geometry=box_2, Motion=Z_3)  # -> Geometry, Transform
Z_4 = UnitZ(Factor=expr("-x", multiplication_11))

multiplication_12 = Multiplication(A=直径_2, B=5)

Z_5 = UnitZ(Factor=multiplication_12)
extr_2 = Extrude(Base=move_8.Geometry, Direction=Z_5)
cap_2 = CapHoles(Brep=[extr_2, cyl_2])
merge_6 = Merge(Data1=cap_2, Data2=box_2)
flatten_2 = FlattenTree(Tree=merge_6, Path="{0}")
move_10 = Move(Geometry=flatten_2, Motion=Z_4)  # -> Geometry, Transform

box_3 = DomainBox(Base=PlaneXY(0, 0, 0), X=dom_4, Y=dom_4, Z=multiplication_11)
merge_7 = Merge(Data1=cap_2, Data2=box_3)
flatten_3 = FlattenTree(Tree=merge_7, Path="{0}")
move_11 = Move(Geometry=flatten_3, Motion=Z_4)  # -> Geometry, Transform
entwine_4 = Entwine(Branch00=move_10.Geometry, Branch01=move_11.Geometry, FlattenInputs=True)

# ---- group: 选单体
板埋or槽埋or板槽埋 = StreamFilter(Gate=list, Stream0=entwine_4, Stream1=entwine_2, Stream2=entwine_3)

# ----
# 三视图
# hidden lines of top+pers view
# move to center
# 如果无法完整的生成埋件的三视图，
# 建议选择埋件的3D在Rhino中将
# Top/Perspective/Front/Right 试图缩放至合适大小后重新运行
panel_18 = Panel("""Top
Perspective
Front
Right""")
m2d_rhino = Make2DRhinoView(Name=panel_18, Clip=True)
make2d = Make2D(Geometry=板埋or槽埋or板槽埋, View=m2d_rhino, TangentEdges=False, TangentSeams=False, AutoComputeMake2D=False)  # -> VisibleCurves, VisibleIndex, VisibleType, HiddenCurves, HiddenIndex, HiddenType
bang = ExplodeTree(Data=make2d.VisibleCurves)  # -> Branch0, Branch1, Branch2, Branch3, Branch4, Branch5, Branch6, Branch7
bang_2 = ExplodeTree(Data=make2d.VisibleCurves)  # -> Branch0, Branch1, Branch2, Branch3, Branch4, Branch5, Branch6, Branch7
divdist = DivideDistance(Curve=make2d.HiddenCurves, Distance=Slider(1, range=0..10))  # -> Points, Tangents, Parameters
graft = GraftTree(Tree=make2d.HiddenCurves, IncludeEmptyLists=True, IncludeNullItems=True)
shatter = Shatter(Curve=graft, Parameters=divdist.Parameters)
dispatch_6 = Dispatch(List=shatter, DispatchPattern=[True, False])  # -> ListA, ListB
crv_24 = Curve(dispatch_6.ListA)
pshift = ShiftPaths(Data=crv_24, Offset=-1)
pshift_2 = ShiftPaths(Data=pshift, Offset=-1)
bang_3 = ExplodeTree(Data=pshift_2)  # -> Branch0, Branch1, Branch2, Branch3, Branch4, Branch5, Branch6, Branch7
bang_4 = ExplodeTree(Data=pshift_2)  # -> Branch0, Branch1, Branch2, Branch3, Branch4, Branch5, Branch6, Branch7
entwine_5 = Entwine(Branch00=bang_4.Branch4, Branch01=bang_2.Branch4, FlattenInputs=True)  # -> flatten(Result)
entwine_6 = Entwine(Branch00=bang_4.Branch5, Branch01=bang_2.Branch5, FlattenInputs=True)  # -> flatten(Result)
entwine_7 = Entwine(Branch00=bang_3.Branch0, Branch01=bang.Branch0, FlattenInputs=True)  # -> flatten(Result)
entwine_8 = Entwine(Branch00=bang_3.Branch1, Branch01=bang.Branch1, FlattenInputs=True)  # -> flatten(Result)
entwine_9 = Entwine(Branch00=entwine_7, Branch01=entwine_8, Branch02=bang.Branch2, Branch03=bang.Branch3, FlattenInputs=True)
entwine_10 = Entwine(Branch00=entwine_5, Branch01=entwine_6, Branch02=bang_2.Branch6, Branch03=bang_2.Branch7, FlattenInputs=True)
group = Group(Objects=entwine_9)
group_2 = Group(Objects=entwine_10)
entwine_11 = Entwine(Branch00=group, Branch01=group_2, FlattenInputs=True)
pshift_3 = ShiftPaths(Data=entwine_11, Offset=-1)
pshift_4 = ShiftPaths(Data=entwine_11, Offset=-1)
number_slider_2 = Slider(2, range=0..10)
# Rhino 文件中导入的块名
boxprop = BoxProperties(Box=pshift_3)  # -> Center, Diagonal, Area, Volume, Degeneracy
pt_7 = Point(Point(957.9296072, 367.7685097, 0))
pt_8 = Point("0,0,0")
recgrid_3 = Rectangular(
    Plane=pt_7,
    SizeX=Slider(12, range=1..20, expression="X*50"),
    SizeY=Slider(10, range=1..20, expression="X*50"),
    ExtentX=number_slider_2,
    ExtentY=number_slider_2)  # -> Cells, Points
vec2pt = Vector2Pt(PointA=boxprop.Center, PointB=pt_8, Unitize=False)  # -> Vector, Length
flatten_4 = FlattenTree(Tree=recgrid_3.Points, Path="{0}")
move_12 = Move(Geometry=pshift_4, Motion=vec2pt.Vector)  # -> flatten(Geometry), Transform
orient_5 = Orient(Geometry=flatten(move_12.Geometry), Source=PlaneXY(0, 0, 0), Target=flatten_4)  # -> Geometry, Transform
cull_i_3 = CullIndex(List=orient_5.Geometry, Indices="-1", Wrap=True)
split = SplitList(List=cull_i_3, Index="4")  # -> ListA, ListB
data_8 = Data(split.ListA)
data_9 = Data(split.ListB)
entwine_12 = Entwine(Branch00=data_8, Branch01=data_9, FlattenInputs=True)
geo_6 = Geometry(entwine_12)

# ---- group: 单体定Top/Side
item_12 = ListItem(List=geo_6, Index=2, Wrap=True)
item_13 = ListItem(List=geo_6, Index=Slider(0, range=0..10), Wrap=True)
cluster = Cluster(G=item_13)
cluster_2 = Cluster(G=item_12)

# ---- group: 单体定Top/Side / Top/Side
filter_8 = StreamFilter(Gate=list_2, Stream0=cluster, Stream1=cluster_2)

# ---- group: 单体定Top/Side / Monomer + Top/Side
filter_9 = StreamFilter(Gate=list, Stream0=filter_8, Stream1=filter_8, Stream2=filter_8)  # -> flatten(Stream)

# ---- group: Block
# 自定义块所在图层
# 自定义块所在图层颜色
# 自定义块名称
panel_19 = Panel("Embeded::Embeded")
layer_3 = DefineLayer(Name=panel_19, Color=ColourSwatch(SwatchColor=RGB(255, 0, 0)))
attributes = DefineObjectAttributes(Layer=layer_3)
block = DefineBlock(Geometry=filter_8, Attributes=attributes, BlockName="Steel Plate", BasePlane=PlaneXY(0, 0, 0))

# ---- group: 正常+阳角+阴角区分
cull_i_4 = CullIndex(List=item_2, Indices=cp.CPIndex, Wrap=True)
crv_25 = Curve(offset)
crv_26 = Curve(flip.Curve)
explode_2 = Explode(Curve=crv_25, Recursive=True)  # -> Segments, Vertices
explode_3 = Explode(Curve=crv_26, Recursive=True)  # -> Segments, Vertices

# ---- group: 阴角定位-细化
item_14 = ListItem(List=item, Index=cp.CPIndex, Wrap=True)

# ----
# 第一层
# 
# Angular Curves(architecture line)
crv_27 = Curve(crv_13)
disc_2 = Discontinuity(Curve=crv_27, Level=1)  # -> Points, Parameters
end = EndPoints(Curve=crv_27)  # -> Start, End
flatten_5 = FlattenTree(Tree=disc_2.Points, Path="{0}")

# ----
# 求内部曲线转折点
crv_28 = Curve(crv_10)
number_slider_3 = Slider(300, range=0..1000)
neg = Negative(Value=number_slider_3)
filter_10 = StreamFilter(Gate=toggle, Stream0=number_slider_3, Stream1=neg)

ext = ExtendCurve(Curve=crv_28, Type=0, Start=number_slider, End=number_slider)

# ----
# 求主体曲线转折点
clscrv = CloseCurve(Curve=crv_14, CloseType=0, Bulge=0.5, Tolerance=0)  # -> Closed, R
crv_29 = Curve(crv_12)
disc_3 = Discontinuity(Curve=graft(crv_29), Level=1)  # -> Points, Parameters
crv_cp_2 = CurveClosestPoint(Point=disc_3.Points, Curve=graft(crv_29))  # -> Point, Parameter, Distance
eval_2 = EvaluateCurve(Curve=graft(crv_29), Parameter=crv_cp_2.Parameter)  # -> flatten(Point), Tangent, flatten(Angle)
deg = Degrees(Radians=eval_2.Angle)
offset_2 = OffsetCurve(Curve=clscrv.Closed, Distance=expr("-X", Slider(300, range=0..1000)), Corners=1)
panel_20 = Panel(deg)
larger_2 = LargerThan(FirstNumber=deg, SecondNumber=Slider(60, range=0..100))  # -> LargerThan, OrEqualTo
disc_4 = Discontinuity(Curve=offset_2, Level=1)  # -> flatten(Points), Parameters
dispatch_7 = Dispatch(List=eval_2.Point, DispatchPattern=larger_2.LargerThan)  # -> ListA, ListB

crv_30 = Curve(clscrv.Closed)
offset_3 = OffsetCurve(Curve=crv_30, Distance=expr("-x", Slider(84, range=0..1000)), Corners=1)  # -> flatten(Curve)
pull_3 = PullPoint(Point=disc_2.Points, Geometry=offset_3, ClosestOnly=True)  # -> ClosestPoint, Distance
disc_5 = Discontinuity(Curve=offset_3, Level=1)  # -> Points, Parameters
pull_4 = PullPoint(Point=flatten(pull_3.ClosestPoint), Geometry=flatten(disc_5.Points), ClosestOnly=True)  # -> ClosestPoint, Distance
check_same_points = CheckSamePoints(archPoint=flatten(pull_3.ClosestPoint), crvPoint=flatten(pull_4.ClosestPoint))  # -> out, specialPt; inputs archPoint: list of Point3d, crvPoint: list of Point3d
# ---------- check_same_points: C# ----------
    List<int> passIndex = new List<int>();

    for(int i = 0; i < archPoint.Count; i++){
      foreach(Point3d t in crvPoint){
        if(archPoint[i].X == t.X && archPoint[i].Y == t.Y && archPoint[i].Z == t.Z){
          Print("pass");
          passIndex.Add(i);}
      }
    }

    specialPt = passIndex;
# ---------- end check_same_points ----------
cull_i_5 = CullIndex(List=flatten(disc_2.Points), Indices=check_same_points.specialPt, Wrap=True)
merge_8 = Merge(Data1=end.Start, Data2=end.End, Data3=cull_i_5)
check_same_points_2 = CheckSamePoints(archPoint=flatten(flatten_5), crvPoint=flatten(merge_8))  # -> out, specialPt; inputs archPoint: list of Point3d, crvPoint: list of Point3d; same code as check_same_points
cull_i_6 = CullIndex(List=flatten(flatten_5), Indices=check_same_points_2.specialPt, Wrap=True)
pull_5 = PullPoint(Point=cull_i_6, Geometry=offset_3, ClosestOnly=True)  # -> ClosestPoint, Distance
ln_2 = Line(StartPoint=cull_i_6, EndPoint=pull_5.ClosestPoint)
rotate_3 = Rotate(Geometry=ln_2, Angle=1.570796327, Plane=cull_i_6)  # -> Geometry, Transform

# ----
# 转角点
data_10 = Data(dispatch_7.ListA)

pull_6 = PullPoint(Point=data_10, Geometry=flatten(offset_2), ClosestOnly=True)  # -> ClosestPoint, Distance
testpoint = TestPoint(archPoint=pull_6.ClosestPoint, crvPoint=disc_4.Points)  # -> out, specialPt; inputs archPoint: list of Point3d, crvPoint: list of Point3d; same code as check_same_points

# ----
# 找阴阳角所在corners
pull_7 = PullPoint(Point=flatten(pln_6), Geometry=crv_29, ClosestOnly=True)  # -> ClosestPoint, Distance
pull_8 = PullPoint(Point=pull_7.ClosestPoint, Geometry=data_10, ClosestOnly=True)  # -> ClosestPoint, Distance
flatten_6 = FlattenTree(Tree=data_6, Path="{0}")
sort_2 = SortList(Keys=pull_8.Distance, ValuesA=flatten_6)  # -> Keys, ValuesA
panel_21 = Panel(sort_2.Keys)
smaller = SmallerThan(FirstNumber=sort_2.Keys, SecondNumber=Slider(100, range=0..100))  # -> SmallerThan, OrEqualTo
dispatch_8 = Dispatch(List=sort_2.ValuesA, DispatchPattern=smaller.SmallerThan)  # -> ListA, ListB
data_11 = Data(dispatch_8.ListA)
deblock_4 = DeconstructBlock(Block=data_11)  # -> Name, Plane, Geometry
deplane_5 = DeconstructPlane(Plane=deblock_4.Plane)  # -> Origin, XAxis, YAxis, ZAxis
pt_9 = Point(data_10)
pull_9 = PullPoint(Point=deplane_5.Origin, Geometry=pt_9, ClosestOnly=True)  # -> ClosestPoint, Distance
cir = Circle(Plane=pull_9.ClosestPoint, Radius=Slider(300, range=0..1000))
crv_31 = Curve(crv_29)
amp_2 = Amplitude(Vector=deplane_5.YAxis, Amplitude=Slider(200, range=0..1000))
ccx = CurveCurve(CurveA=cir, CurveB=crv_31)  # -> Points, ParamsA, ParamsB
move_13 = Move(Geometry=pull_9.ClosestPoint, Motion=amp_2)  # -> Geometry, Transform
item_15 = ListItem(List=ccx.Points, Index=0, Wrap=True)
clean = CleanTree(RemoveNulls=True, RemoveInvalid=True, RemoveEmpty=Toggle(True), Tree=item_15)
ln_3 = Line(StartPoint=pull_9.ClosestPoint, EndPoint=clean)
ln_4 = Line(StartPoint=pull_9.ClosestPoint, EndPoint=move_13.Geometry)
angle = Angle(VectorA=ln_4, VectorB=ln_3)  # -> Angle, Reflex
deg_2 = Degrees(Radians=angle.Angle)
flatten_7 = FlattenTree(Tree=deg_2, Path="{0}")
panel_22 = Panel(flatten_7)
c_script = CSharpScript(angle=flatten_7, minus=Slider(80, range=0..100))  # -> out, results; inputs angle: list of Double, minus: Double
# ---------- c_script: C# ----------
    List<double> MyAngle = new List<double>();
    for(int i = 0; i < angle.Count; i++){
      if (angle[i] > minus){
        angleEach = angle[i] - 90;
        Print("!!!!!!!!");
        MyAngle.Add(angleEach);
      }
      else{
        angleEach = angle[i];
        Print("00000");
        MyAngle.Add(angleEach);
      }

    }

    results = MyAngle;
# ---------- c_script: C# additional code ----------
  double angleEach = 0;
# ---------- end c_script ----------
larger_3 = LargerThan(FirstNumber=c_script.results, SecondNumber=Slider(30, range=0..100))  # -> LargerThan, OrEqualTo
panel_23 = Panel(c_script.results)
dispatch_9 = Dispatch(List=flatten(data_11), DispatchPattern=flatten(larger_3.LargerThan))  # -> ListA, ListB
data_12 = Data(dispatch_9.ListA)

# ----
# SmoothCurve-阴角&阳角
# 阳角
item_16 = ListItem(List=data_10, Index=testpoint.specialPt, Wrap=True)

# ----
# 阴角
cull_i_7 = CullIndex(List=data_10, Indices=testpoint.specialPt, Wrap=True)

# ----
# remove duplicate block and reconstruct plane
deblock_5 = DeconstructBlock(Block=data_12)  # -> Name, Plane, Geometry
deplane_6 = DeconstructPlane(Plane=flatten(deblock_5.Plane))  # -> Origin, XAxis, YAxis, ZAxis

# ----
# 第一层
# 
# Block(location point) + Smooth Curves(architecture line)
pln_8 = Plane(flatten(pln_6))
deplane_7 = DeconstructPlane(Plane=pln_8)  # -> Origin, XAxis, YAxis, ZAxis
testpoint_2 = TestPoint(archPoint=deplane_7.Origin, crvPoint=deplane_6.Origin)  # -> out, specialPt; inputs archPoint: list of Point3d, crvPoint: list of Point3d; same code as check_same_points
cull_i_8 = CullIndex(List=pln_8, Indices=testpoint_2.specialPt, Wrap=True)
pln_9 = Plane(deblock_5.Plane)
dist = Distance(PointA=graft(deplane_6.Origin), PointB=item_16)
sort_3 = SortList(Keys=dist)  # -> Keys, ValuesA
item_17 = ListItem(List=sort_3.Keys, Index=0, Wrap=True)
flatten_8 = FlattenTree(Tree=item_17, Path="{0}")
smaller_2 = SmallerThan(FirstNumber=item_17, SecondNumber=Slider(100, range=0..300))  # -> SmallerThan, OrEqualTo
panel_24 = Panel(flatten_8)
dispatch_10 = Dispatch(List=graft(pln_9), DispatchPattern=smaller_2.SmallerThan)  # -> ListA, ListB

pln_10 = Plane(cull_i_8)

data_13 = Data(flatten(dispatch_10.ListA))
deplane_8 = DeconstructPlane(Plane=data_13)  # -> Origin, XAxis, YAxis, ZAxis
amp_3 = Amplitude(Vector=deplane_8.YAxis, Amplitude=Slider(300, range=0..1000))
move_14 = Move(Geometry=deplane_8.Origin, Motion=amp_3)  # -> Geometry, Transform
ln_5 = Line(StartPoint=deplane_8.Origin, EndPoint=move_14.Geometry)
midpt_2 = CurveMiddle(Curve=ln_5)
scale_2 = Scale(Geometry=ln_5, Center=midpt_2, Factor=Slider(1.5, range=0..10))  # -> Geometry, Transform
ccx_2 = CurveCurve(CurveA=graft(scale_2.Geometry), CurveB=crv_20)  # -> flatten(Points), ParamsA, ParamsB

data_14 = Data(flatten(dispatch_10.ListB))
deplane_9 = DeconstructPlane(Plane=data_14)  # -> Origin, XAxis, YAxis, ZAxis
amp_4 = Amplitude(Vector=deplane_9.YAxis, Amplitude=Slider(300, range=0..1000))
move_15 = Move(Geometry=deplane_9.Origin, Motion=amp_4)  # -> Geometry, Transform
ln_6 = Line(StartPoint=deplane_9.Origin, EndPoint=move_15.Geometry)
midpt_3 = CurveMiddle(Curve=ln_6)
scale_3 = Scale(Geometry=ln_6, Center=midpt_3, Factor=Slider(1.5, range=0..10))  # -> Geometry, Transform
ccx_3 = CurveCurve(CurveA=graft(scale_3.Geometry), CurveB=crv_20)  # -> flatten(Points), ParamsA, ParamsB

data_15 = Data(flatten(pln_10))
deplane_10 = DeconstructPlane(Plane=data_15)  # -> Origin, XAxis, YAxis, ZAxis
amp_5 = Amplitude(Vector=deplane_10.YAxis, Amplitude=Slider(300, range=0..1000))
move_16 = Move(Geometry=deplane_10.Origin, Motion=amp_5)  # -> Geometry, Transform
ln_7 = Line(StartPoint=deplane_10.Origin, EndPoint=move_16.Geometry)
midpt_4 = CurveMiddle(Curve=ln_7)
scale_4 = Scale(Geometry=ln_7, Center=midpt_4, Factor=Slider(4.7, range=0..10))  # -> Geometry, Transform
ccx_4 = CurveCurve(CurveA=graft(scale_4.Geometry), CurveB=crv_20)  # -> flatten(Points), ParamsA, ParamsB

pl_2 = ConstructPlane(Origin=cull_i_6, XAxis=ln_2, YAxis=rotate_3.Geometry)

# ----
# SmoothCurve-正常
move2pt = MoveToPoint(Geometry=data_15, PointA=deplane_10.Origin, PointB=ccx_4.Points)  # -> Moved, Vector, Transform

# ----
# SmoothCurve-阳角
move2pt_2 = MoveToPoint(Geometry=data_13, PointA=deplane_8.Origin, PointB=ccx_2.Points)  # -> Moved, Vector, Transform

# ----
# SmoothCurve-阴角
move2pt_3 = MoveToPoint(Geometry=data_14, PointA=deplane_9.Origin, PointB=ccx_3.Points)  # -> Moved, Vector, Transform

# ----
# 第一层
# 
# Curves(location point)+ Smooth Curves(architecture line)
area_8 = Area(Geometry=geo_3)  # -> Area, Centroid
pull_10 = PullPoint(Point=area_8.Centroid, Geometry=crv_19, ClosestOnly=True)  # -> ClosestPoint, Distance
dist_2 = Distance(PointA=pull_10.ClosestPoint, PointB=data_10)
sort_4 = SortList(Keys=dist_2)  # -> Keys, ValuesA
panel_25 = Panel(sort_4.Keys)
smaller_3 = SmallerThan(FirstNumber=dist_2, SecondNumber=Slider(200, range=0..1000))  # -> SmallerThan, OrEqualTo
dispatch_11 = Dispatch(List=geo_3, DispatchPattern=smaller_3.SmallerThan)  # -> ListA, ListB
crv_32 = Curve(crv_12)

# ----
# 第二层-阴阳角
data_16 = Data(dispatch_11.ListA)
explode_4 = Explode(Curve=data_16, Recursive=True)  # -> Segments, Vertices
len = Length(Curve=explode_4.Segments)
sort_5 = SortList(Keys=reverse(len), ValuesA=explode_4.Segments)  # -> Keys, ValuesA
item_18 = ListItem(List=sort_5.ValuesA, Index=0, Wrap=True)  # -> flatten(Item)
area_9 = Area(Geometry=data_16)  # -> Area, Centroid
midpt_5 = CurveMiddle(Curve=item_18)
move2pt_4 = MoveToPoint(Geometry=item_18, PointA=midpt_5, PointB=area_9.Centroid)  # -> Moved, Vector, Transform
end_2 = EndPoints(Curve=move2pt_4.Moved)  # -> Start, End
ln_8 = Line(StartPoint=end_2.Start, EndPoint=end_2.End)
neg_2 = Negative(Value="0.5 * Pi")
filter_11 = StreamFilter(Gate=Toggle(True), Stream0="0.5 * Pi", Stream1=neg_2)
xy_18 = XYPlane(Origin=end_2.End)
rotate_4 = Rotate(Geometry=ln_8, Angle=filter_11, Plane=xy_18)  # -> Geometry, Transform
pl_3 = ConstructPlane(Origin=end_2.End, XAxis=rotate_4.Geometry, YAxis=ln_8)

# ----
# 第二层-大面定位
data_17 = Data(dispatch_11.ListB)
explode_5 = Explode(Curve=data_17, Recursive=True)  # -> Segments, Vertices
len_2 = Length(Curve=explode_5.Segments)
sort_6 = SortList(Keys=reverse(len_2), ValuesA=explode_5.Segments)  # -> Keys, ValuesA
item_19 = ListItem(List=sort_6.ValuesA, Index=0, Wrap=True)  # -> flatten(Item)
area_10 = Area(Geometry=data_17)  # -> Area, Centroid
midpt_6 = CurveMiddle(Curve=item_19)
move2pt_5 = MoveToPoint(Geometry=item_19, PointA=midpt_6, PointB=area_10.Centroid)  # -> Moved, Vector, Transform
end_3 = EndPoints(Curve=move2pt_5.Moved)  # -> Start, End
ln_9 = Line(StartPoint=end_3.Start, EndPoint=end_3.End)
neg_3 = Negative(Value="0.5 * Pi")
filter_12 = StreamFilter(Gate=Toggle(True), Stream0="0.5 * Pi", Stream1=neg_3)
xy_19 = XYPlane(Origin=end_3.End)
rotate_5 = Rotate(Geometry=ln_9, Angle=filter_12, Plane=xy_19)  # -> Geometry, Transform

dist_3 = Distance(PointA=graft(end_2.End), PointB=item_16)
sort_7 = SortList(Keys=dist_3)  # -> Keys, ValuesA
item_20 = ListItem(List=sort_7.Keys, Index=0, Wrap=True)
smaller_4 = SmallerThan(FirstNumber=item_20, SecondNumber=Slider(100, range=0..300))  # -> SmallerThan, OrEqualTo
flatten_9 = FlattenTree(Tree=item_20, Path="{0}")
dispatch_12 = Dispatch(List=graft(pl_3), DispatchPattern=smaller_4.SmallerThan)  # -> ListA, ListB
panel_26 = Panel(flatten_9)
pl_4 = ConstructPlane(Origin=end_3.End, XAxis=rotate_5.Geometry, YAxis=ln_9)

data_18 = Data(flatten(dispatch_12.ListA))
deplane_11 = DeconstructPlane(Plane=data_18)  # -> Origin, XAxis, YAxis, ZAxis
amp_6 = Amplitude(Vector=deplane_11.YAxis, Amplitude=Slider(300, range=0..1000))
move_17 = Move(Geometry=deplane_11.Origin, Motion=amp_6)  # -> Geometry, Transform
ln_10 = Line(StartPoint=deplane_11.Origin, EndPoint=move_17.Geometry)
midpt_7 = CurveMiddle(Curve=ln_10)
scale_5 = Scale(Geometry=ln_10, Center=midpt_7, Factor=Slider(1.5, range=0..10))  # -> Geometry, Transform
ccx_5 = CurveCurve(CurveA=graft(scale_5.Geometry), CurveB=crv_32)  # -> flatten(Points), ParamsA, ParamsB

data_19 = Data(flatten(dispatch_12.ListB))
deplane_12 = DeconstructPlane(Plane=data_19)  # -> Origin, XAxis, YAxis, ZAxis
amp_7 = Amplitude(Vector=deplane_12.YAxis, Amplitude=Slider(300, range=0..1000))
move_18 = Move(Geometry=deplane_12.Origin, Motion=amp_7)  # -> Geometry, Transform
ln_11 = Line(StartPoint=deplane_12.Origin, EndPoint=move_18.Geometry)
midpt_8 = CurveMiddle(Curve=ln_11)
scale_6 = Scale(Geometry=ln_11, Center=midpt_8, Factor=Slider(1.5, range=0..10))  # -> Geometry, Transform
ccx_6 = CurveCurve(CurveA=graft(scale_6.Geometry), CurveB=crv_32)  # -> flatten(Points), ParamsA, ParamsB

data_20 = Data(flatten(pl_4))
deplane_13 = DeconstructPlane(Plane=data_20)  # -> Origin, XAxis, YAxis, ZAxis
amp_8 = Amplitude(Vector=deplane_13.YAxis, Amplitude=Slider(300, range=0..1000))
move_19 = Move(Geometry=deplane_13.Origin, Motion=amp_8)  # -> Geometry, Transform
ln_12 = Line(StartPoint=deplane_13.Origin, EndPoint=move_19.Geometry)
midpt_9 = CurveMiddle(Curve=ln_12)
scale_7 = Scale(Geometry=ln_12, Center=midpt_9, Factor=Slider(8.8, range=0..10))  # -> Geometry, Transform
ccx_7 = CurveCurve(CurveA=graft(scale_7.Geometry), CurveB=crv_32)  # -> flatten(Points), ParamsA, ParamsB

# ----
# SmoothCurve-阳角
move2pt_6 = MoveToPoint(Geometry=data_18, PointA=deplane_11.Origin, PointB=ccx_5.Points)  # -> Moved, Vector, Transform

# ----
# SmoothCurve-阴角
move2pt_7 = MoveToPoint(Geometry=data_19, PointA=deplane_12.Origin, PointB=ccx_6.Points)  # -> Moved, Vector, Transform

# ----
# SmoothCurve-正常
move2pt_8 = MoveToPoint(Geometry=data_20, PointA=deplane_13.Origin, PointB=ccx_7.Points)  # -> Moved, Vector, Transform

# ----
# 第二层
# 
# Curves(location point)+ Smooth Curves(architecture line)
# 第二层-区分阴阳角
area_11 = Area(Geometry=geo_5)  # -> Area, Centroid
crv_33 = Curve(crv_28)
pull_11 = PullPoint(Point=area_11.Centroid, Geometry=crv_33, ClosestOnly=True)  # -> ClosestPoint, Distance

# ----
# 第二层-阴阳角
panel_27 = Panel("0.5 * Pi")
neg_4 = Negative(Value=panel_27)
filter_13 = StreamFilter(Gate=Toggle(True), Stream0=panel_27, Stream1=neg_4)

# ----
# 第二层-大面定位
panel_28 = Panel("0.5 * Pi")
neg_5 = Negative(Value=panel_28)
filter_14 = StreamFilter(Gate=Toggle(True), Stream0=panel_28, Stream1=neg_5)

# ----
# 显示"False"时要选择线段延长
list_9 = ValueList({"线段不延长": 0, "线段延长": 1}, selected="线段延长")

filter_15 = StreamFilter(Gate=list_9, Stream0=crv_28, Stream1=ext)

disc_6 = Discontinuity(Curve=graft(filter_15), Level=1)  # -> Points, Parameters
crv_cp_3 = CurveClosestPoint(Point=disc_6.Points, Curve=graft(filter_15))  # -> Point, Parameter, Distance
eval_3 = EvaluateCurve(Curve=graft(filter_15), Parameter=crv_cp_3.Parameter)  # -> flatten(Point), Tangent, flatten(Angle)
deg_3 = Degrees(Radians=eval_3.Angle)
offset_4 = OffsetCurve(Curve=filter_15, Distance=expr("-X", filter_10), Corners=1)
panel_29 = Panel(deg_3)
larger_4 = LargerThan(FirstNumber=deg_3, SecondNumber=Slider(60, range=0..100))  # -> LargerThan, OrEqualTo
disc_7 = Discontinuity(Curve=offset_4, Level=1)  # -> flatten(Points), Parameters
dispatch_13 = Dispatch(List=eval_3.Point, DispatchPattern=larger_4.LargerThan)  # -> ListA, ListB
end_4 = EndPoints(Curve=filter_15)  # -> Start, End
data_21 = Data(dispatch_13.ListA)
pull_12 = PullPoint(Point=data_21, Geometry=flatten(offset_4), ClosestOnly=True)  # -> ClosestPoint, Distance
testpoint_3 = TestPoint(archPoint=pull_12.ClosestPoint, crvPoint=disc_7.Points)  # -> out, specialPt; inputs archPoint: list of Point3d, crvPoint: list of Point3d; same code as check_same_points

# ----
# 阴角
item_21 = ListItem(List=data_21, Index=testpoint_3.specialPt, Wrap=True)

# ----
# SmoothCurve-阴角&阳角
# 阳角
cull_i_9 = CullIndex(List=data_21, Indices=testpoint_3.specialPt, Wrap=True)

dist_4 = Distance(PointA=pull_11.ClosestPoint, PointB=data_21)
sort_8 = SortList(Keys=dist_4)  # -> Keys, ValuesA
panel_30 = Panel(sort_8.Keys)
smaller_5 = SmallerThan(FirstNumber=dist_4, SecondNumber=Slider(200, range=0..1000))  # -> SmallerThan, OrEqualTo
dispatch_14 = Dispatch(List=geo_5, DispatchPattern=smaller_5.SmallerThan)  # -> ListA, ListB
crv_34 = Curve(filter_15)

data_22 = Data(dispatch_14.ListA)
explode_6 = Explode(Curve=data_22, Recursive=True)  # -> Segments, Vertices
len_3 = Length(Curve=explode_6.Segments)
sort_9 = SortList(Keys=reverse(len_3), ValuesA=explode_6.Segments)  # -> Keys, ValuesA
item_22 = ListItem(List=sort_9.ValuesA, Index=0, Wrap=True)  # -> flatten(Item)
area_12 = Area(Geometry=data_22)  # -> Area, Centroid
midpt_10 = CurveMiddle(Curve=item_22)
move2pt_9 = MoveToPoint(Geometry=item_22, PointA=midpt_10, PointB=area_12.Centroid)  # -> Moved, Vector, Transform
end_5 = EndPoints(Curve=move2pt_9.Moved)  # -> Start, End
ln_13 = Line(StartPoint=end_5.Start, EndPoint=end_5.End)
xy_20 = XYPlane(Origin=end_5.End)
rotate_6 = Rotate(Geometry=ln_13, Angle=filter_13, Plane=xy_20)  # -> Geometry, Transform
pl_5 = ConstructPlane(Origin=end_5.End, XAxis=rotate_6.Geometry, YAxis=ln_13)

data_23 = Data(dispatch_14.ListB)
explode_7 = Explode(Curve=data_23, Recursive=True)  # -> Segments, Vertices
len_4 = Length(Curve=explode_7.Segments)
sort_10 = SortList(Keys=reverse(len_4), ValuesA=explode_7.Segments)  # -> Keys, ValuesA
item_23 = ListItem(List=sort_10.ValuesA, Index=0, Wrap=True)  # -> flatten(Item)
area_13 = Area(Geometry=data_23)  # -> Area, Centroid
midpt_11 = CurveMiddle(Curve=item_23)
move2pt_10 = MoveToPoint(Geometry=item_23, PointA=midpt_11, PointB=area_13.Centroid)  # -> Moved, Vector, Transform
end_6 = EndPoints(Curve=move2pt_10.Moved)  # -> Start, End
ln_14 = Line(StartPoint=end_6.Start, EndPoint=end_6.End)
xy_21 = XYPlane(Origin=end_6.End)
rotate_7 = Rotate(Geometry=ln_14, Angle=filter_14, Plane=xy_21)  # -> Geometry, Transform
pl_6 = ConstructPlane(Origin=end_6.End, XAxis=rotate_7.Geometry, YAxis=ln_14)

data_24 = Data(flatten(pl_6))
deplane_14 = DeconstructPlane(Plane=data_24)  # -> Origin, XAxis, YAxis, ZAxis
amp_9 = Amplitude(Vector=deplane_14.YAxis, Amplitude=Slider(300, range=0..1000))
move_20 = Move(Geometry=deplane_14.Origin, Motion=amp_9)  # -> Geometry, Transform
ln_15 = Line(StartPoint=deplane_14.Origin, EndPoint=move_20.Geometry)
midpt_12 = CurveMiddle(Curve=ln_15)
scale_8 = Scale(Geometry=ln_15, Center=midpt_12, Factor=Slider(1.5, range=0..10))  # -> Geometry, Transform
ccx_8 = CurveCurve(CurveA=scale_8.Geometry, CurveB=crv_34)  # -> Points, ParamsA, ParamsB

dist_5 = Distance(PointA=graft(end_5.End), PointB=cull_i_9)
sort_11 = SortList(Keys=dist_5)  # -> Keys, ValuesA
item_24 = ListItem(List=sort_11.Keys, Index=0, Wrap=True)
smaller_6 = SmallerThan(FirstNumber=item_24, SecondNumber=Slider(100, range=0..300))  # -> SmallerThan, OrEqualTo
flatten_10 = FlattenTree(Tree=item_24, Path="{0}")
dispatch_15 = Dispatch(List=graft(pl_5), DispatchPattern=smaller_6.SmallerThan)  # -> ListA, ListB
panel_31 = Panel(flatten_10)
flatten_11 = FlattenTree(Tree=ccx_8.Points, Path="{0}")
lng = ListLength(List=scale_8.Geometry)
lng_2 = ListLength(List=flatten_11)

data_25 = Data(flatten(dispatch_15.ListA))
deplane_15 = DeconstructPlane(Plane=data_25)  # -> Origin, XAxis, YAxis, ZAxis
amp_10 = Amplitude(Vector=deplane_15.YAxis, Amplitude=Slider(300, range=0..1000))
move_21 = Move(Geometry=deplane_15.Origin, Motion=amp_10)  # -> Geometry, Transform
ln_16 = Line(StartPoint=deplane_15.Origin, EndPoint=move_21.Geometry)
midpt_13 = CurveMiddle(Curve=ln_16)
scale_9 = Scale(Geometry=ln_16, Center=midpt_13, Factor=Slider(1.5, range=0..10))  # -> Geometry, Transform
ccx_9 = CurveCurve(CurveA=scale_9.Geometry, CurveB=crv_34)  # -> Points, ParamsA, ParamsB

data_26 = Data(flatten(dispatch_15.ListB))
deplane_16 = DeconstructPlane(Plane=data_26)  # -> Origin, XAxis, YAxis, ZAxis
amp_11 = Amplitude(Vector=deplane_16.YAxis, Amplitude=Slider(300, range=0..1000))
move_22 = Move(Geometry=deplane_16.Origin, Motion=amp_11)  # -> Geometry, Transform
ln_17 = Line(StartPoint=deplane_16.Origin, EndPoint=move_22.Geometry)
midpt_14 = CurveMiddle(Curve=ln_17)
scale_10 = Scale(Geometry=ln_17, Center=midpt_14, Factor=Slider(1.5, range=0..10))  # -> Geometry, Transform
ccx_10 = CurveCurve(CurveA=scale_10.Geometry, CurveB=crv_34)  # -> Points, ParamsA, ParamsB

equals = Equality(FirstNumber=lng, SecondNumber=lng_2)  # -> Equality, Inequality
panel_32 = Panel(equals.Equality)

# ----
# InsideCurve-阳角
move2pt_11 = MoveToPoint(Geometry=data_25, PointA=deplane_15.Origin, PointB=ccx_9.Points)  # -> Moved, Vector, Transform

# ----
# InsideCurve-阴角
move2pt_12 = MoveToPoint(Geometry=data_26, PointA=deplane_16.Origin, PointB=ccx_10.Points)  # -> Moved, Vector, Transform

# ----
# InsideCurve-大面
move2pt_13 = MoveToPoint(Geometry=data_24, PointA=flatten(deplane_14.Origin), PointB=flatten(ccx_8.Points))  # -> Moved, Vector, Transform

# ---- group: 大面
# 大面埋件布置
number_slider_4 = Slider(0.002, range=0..0.01)
filter_16 = StreamFilter(Gate=list_2, Stream0=expression_4, Stream1=number_slider_4)
filter_17 = StreamFilter(Gate=list, Stream0=filter_16, Stream1=expression_4, Stream2=filter_16)
offset_5 = OffsetCurve(Curve=offset, Distance=expr("-x", filter_17), Plane=PlaneXY(0, 0, 0), Corners=1)

# ---- group: 阴阳角区分 (continued)
crv_cp_4 = CurveClosestPoint(Point=item_7, Curve=offset_5)  # -> Point, Parameter, Distance
vec2pt_2 = Vector2Pt(PointA=crv_cp_4.Point, PointB=crv_cp.Point, Unitize=False)  # -> expr("-x", Vector), Length
angle_2 = Angle(VectorA=eval.Tangent, VectorB=vec2pt_2.Vector)  # -> Angle, Reflex
deg_4 = Degrees(Radians=angle_2.Angle)
smaller_7 = SmallerThan(FirstNumber=deg_4, SecondNumber=89)  # -> SmallerThan, OrEqualTo
dispatch_16 = Dispatch(List=item_7, DispatchPattern=smaller_7.SmallerThan)  # -> ListA, ListB

# ---- group: 正常+阳角+阴角区分 (continued)
data_27 = Data(dispatch_16.ListA)
data_28 = Data(dispatch_16.ListB)
pull_13 = PullPoint(Point=data_27, Geometry=crv_25, ClosestOnly=True)  # -> ClosestPoint, Distance
pull_14 = PullPoint(Point=data_28, Geometry=crv_26, ClosestOnly=True)  # -> ClosestPoint, Distance
c_script_2 = CSharpScript(archPoint=pull_13.ClosestPoint, crvPoint=explode_2.Vertices)  # -> out, specialPt; inputs archPoint: list of Point3d, crvPoint: list of Point3d; same code as check_same_points
c_script_3 = CSharpScript(archPoint=pull_14.ClosestPoint, crvPoint=explode_3.Vertices)  # -> out, specialPt; inputs archPoint: list of Point3d, crvPoint: list of Point3d; same code as check_same_points
cull_i_10 = CullIndex(List=data_27, Indices=c_script_2.specialPt, Wrap=True)

# ---- group: 阴角定位-细化 (continued)
dispatch_17 = Dispatch(List=item_14, DispatchPattern=smaller_7.SmallerThan)  # -> ListA, ListB
item_25 = ListItem(List=dispatch_17.ListB, Index=c_script_3.specialPt, Wrap=True)
join_2 = JoinCurves(Curves=item_25, Preserve=False)
explode_8 = Explode(Curve=join_2, Recursive=True)  # -> Segments, Vertices
crv_35 = Curve(simplify(explode_8.Segments))
len_5 = Length(Curve=crv_35)
sort_12 = SortList(Keys=len_5, ValuesA=crv_35)  # -> Keys, ValuesA
item_26 = ListItem(List=sort_12.ValuesA, Index=0, Wrap=True)  # -> Item2, Item1, Item
crv_36 = Curve([item_26.Item2, item_26.Item1])
disc_8 = Discontinuity(Curve=crv_36, Level=1)  # -> Points, Parameters
item_27 = ListItem(List=disc_8.Points, Index=0, Wrap=True)
pull_15 = PullPoint(Point=disc_8.Points, Geometry=pt_2, ClosestOnly=True)  # -> ClosestPoint, Distance
crv_cp_5 = CurveClosestPoint(Point=disc_8.Points, Curve=offset)  # -> Point, Parameter, Distance
sort_13 = SortList(Keys=pull_15.Distance, ValuesA=crv_cp_5.Point)  # -> Keys, ValuesA

# ---- group: 正常+阳角+阴角区分 / 正常-遗漏
cull_i_11 = CullIndex(List=data_28, Indices=c_script_3.specialPt, Wrap=True)

# ---- group: 正常+阳角+阴角区分 / 阴角定位点
item_28 = ListItem(List=data_28, Index=c_script_3.specialPt, Wrap=True)

# ---- group: 正常+阳角+阴角区分 / 正常定位点
merge_9 = Merge(Data1=cull_i_4, Data2=cull_i_11, Data3=cull_i_10)

# ---- group: 正常+阳角+阴角区分 / 阳角定位点
item_29 = ListItem(List=data_27, Index=c_script_2.specialPt, Wrap=True)

# ---- group: 阴角定位-细化 / 阴角-2点定位
item_30 = ListItem(List=sort_13.ValuesA, Index=0, Wrap=True)

# ----
# 阳角埋件布置
pt_10 = Point(item_29)
explode_9 = Explode(Curve=crv_21, Recursive=True)  # -> Segments, Vertices
cp_2 = ClosestPoint(Point=pt_10, Cloud=explode_9.Vertices)  # -> ClosestPoint, CPIndex, Distance
cir_2 = Circle(Plane=cp_2.ClosestPoint, Radius=Slider(150, range=0..1000))
pt_11 = Point(cp_2.ClosestPoint)
ccx_11 = CurveCurve(CurveA=cir_2, CurveB=offset)  # -> Points, ParamsA, ParamsB
item_31 = ListItem(List=ccx_11.Points, Index=0, Wrap=True)  # -> Item, Item1
ln_18 = Line(StartPoint=graft(pt_11), EndPoint=graft(item_31.Item))  # -> flatten(Line)
ln_19 = Line(StartPoint=graft(pt_11), EndPoint=graft(item_31.Item1))  # -> flatten(Line)
item_32 = ListItem(List=filter_9, Index="1", Wrap=True)
pl_7 = ConstructPlane(Origin=pt_11, XAxis=ln_18, YAxis=ln_19)
bbox_6 = BoundingBox(Content=graft(item_32), Plane=PlaneXY(0, 0, 0))  # -> Box, Box_2
srf = Surface(bbox_6.Box)
explode_10 = Explode(Curve=srf, Recursive=True)  # -> Segments, Vertices
item_33 = ListItem(List=explode_10.Vertices, Index=0, Wrap=True)  # -> Item, Item1, Item2
ln_20 = Line(StartPoint=graft(item_33.Item1), EndPoint=graft(item_33.Item2))
ln_21 = Line(StartPoint=graft(item_33.Item1), EndPoint=graft(item_33.Item))
ln_22 = Line(StartPoint=graft(item_33.Item1), EndPoint=graft(item_33.Item))
ln_23 = Line(StartPoint=graft(item_33.Item1), EndPoint=graft(item_33.Item2))
pl_8 = ConstructPlane(Origin=item_33.Item1, XAxis=ln_23, YAxis=ln_22)
pl_9 = ConstructPlane(Origin=item_33.Item1, XAxis=ln_21, YAxis=ln_20)
orient_6 = Orient(Geometry=item_32, Source=pl_9, Target=pl_7)  # -> Geometry, Transform
orient_7 = Orient(Geometry=item_32, Source=pl_8, Target=pl_7)  # -> Geometry, Transform
merge_10 = Merge(Data1=orient_6.Geometry, Data2=orient_7.Geometry)
filter_18 = StreamFilter(Gate=list_2, Stream0=orient_6.Geometry, Stream1=merge_10)
bbox_7 = BoundingBox(Content=filter_18, Plane=PlaneXY(0, 0, 0))  # -> Box, Box_2
entwine_13 = Entwine(Branch00=filter_18, Branch01=bbox_7.Box, FlattenInputs=True)
flip_3 = FlipMatrix(Data=entwine_13)
item_34 = ListItem(List=flip_3, Index=-1, Wrap=True)  # -> flatten(Item)
item_35 = ListItem(List=flip_3, Index="0", Wrap=True)  # -> flatten(Item)

# ---- group: 阴角
# 阴角埋件布置
explode_11 = Explode(Curve=crv_21, Recursive=True)  # -> Segments, Vertices
cp_3 = ClosestPoint(Point=item_28, Cloud=explode_11.Vertices)  # -> ClosestPoint, CPIndex, Distance
pshift_5 = ShiftPaths(Data=item_30, Offset=-1)
crv_cp_6 = CurveClosestPoint(Point=pshift_5, Curve=offset_5)  # -> Point, Parameter, Distance
crv_cp_7 = CurveClosestPoint(Point=pshift_5, Curve=offset)  # -> Point, Parameter, Distance
vec2pt_3 = Vector2Pt(PointA=crv_cp_6.Point, PointB=crv_cp_7.Point, Unitize=False)  # -> expr("-x", Vector), Length
eval_4 = EvaluateCurve(Curve=offset, Parameter=crv_cp_7.Parameter)  # -> Point, Tangent, Angle
pl_10 = ConstructPlane(Origin=crv_cp_7.Point, XAxis=eval_4.Tangent, YAxis=vec2pt_3.Vector)
orient_8 = Orient(Geometry=block, Source=PlaneXY(0, 0, 0), Target=pl_10)  # -> Geometry, Transform

# ---- group: 大面 (continued)
crv_cp_8 = CurveClosestPoint(Point=merge_9, Curve=offset_5)  # -> Point, Parameter, Distance
crv_cp_9 = CurveClosestPoint(Point=merge_9, Curve=offset)  # -> Point, Parameter, Distance
vec2pt_4 = Vector2Pt(PointA=crv_cp_8.Point, PointB=crv_cp_9.Point, Unitize=False)  # -> expr("-x", Vector), Length
eval_5 = EvaluateCurve(Curve=offset, Parameter=crv_cp_9.Parameter)  # -> Point, Tangent, Angle
pl_11 = ConstructPlane(Origin=crv_cp_9.Point, XAxis=eval_5.Tangent, YAxis=vec2pt_4.Vector)
orient_9 = Orient(Geometry=block, Source=PlaneXY(0, 0, 0), Target=pl_11)  # -> flatten(Geometry), Transform

# ---- group: Datea / 2
lng_3 = ListLength(List=orient_9.Geometry)
division_10 = Division(A=lng_3, B=2)
split_2 = SplitList(List=orient_9.Geometry, Index=division_10)  # -> ListA, ListB
data_29 = Data(split_2.ListA)

# ----
bbox_8 = BoundingBox(Content=data_29, Plane=PlaneXY(0, 0, 0))  # -> Box, Box_2
entwine_14 = Entwine(Branch00=data_29, Branch01=bbox_8.Box, FlattenInputs=True)
flip_4 = FlipMatrix(Data=entwine_14)
item_36 = ListItem(List=flip_4, Index=-1, Wrap=True)  # -> flatten(Item)
item_37 = ListItem(List=flip_4, Index="0", Wrap=True)  # -> flatten(Item)
阴角 = Geometry(orient_8.Geometry)

# ---- group: Monomer + Side/Top / Monomer Type
filter_19 = StreamFilter(Gate=list, Stream0=item_34, Stream1=item_34, Stream2=item_34)

# ----
# 槽埋-角部倾斜时
bbox_9 = BoundingBox(Content=item_34, Plane=PlaneXY(0, 0, 0))  # -> Box, Box_2
ln_24 = Line(StartPoint=pt_10, EndPoint=pt_11)
debrep = DeconstructBrep(Brep=bbox_9.Box)  # -> Faces, Edges, Vertices
deplane_17 = DeconstructPlane(Plane=ln_24)  # -> Origin, XAxis, YAxis, ZAxis
len_6 = Length(Curve=debrep.Edges)
sort_14 = SortList(Keys=len_6, ValuesA=debrep.Edges)  # -> Keys, reverse(ValuesA)
amp_12 = Amplitude(Vector=deplane_17.XAxis, Amplitude=Slider(63.5, range=10..100))
item_38 = ListItem(List=sort_14.ValuesA, Index=0, Wrap=True)  # -> Item, Item1, Item2
item_39 = ListItem(List=sort_14.ValuesA, Index=0, Wrap=True)
move_23 = Move(Geometry=deplane_17.Origin, Motion=amp_12)  # -> Geometry, Transform
len_7 = Length(Curve=item_39)
end_7 = EndPoints(Curve=item_38.Item2)  # -> Start, End
end_8 = EndPoints(Curve=item_38.Item1)  # -> Start, End
ln_25 = Line(StartPoint=deplane_17.Origin, EndPoint=move_23.Geometry)
ln_26 = Line(StartPoint=move_23.Geometry, EndPoint=deplane_17.Origin)
avr = Average(Input=[end_8.Start, end_8.End])
ln_27 = Line(StartPoint=end_7.Start, EndPoint=end_7.End)
ln_28 = Line(StartPoint=end_8.Start, EndPoint=avr)
c_script_4 = CSharpScript(iReset=Toggle(True), turns=Slider(30, range=0..100), steps=Slider(10, range=0..10))  # -> out, num; inputs numDefault: Double, iReset: Boolean, turns: Int32, steps: Double
# ---------- c_script_4: C# ----------
    if(iReset){
      number = 0;}

    for(int i = 0; i < turns;i++){
      number = number + steps;
      numStore.Add(number);
      Print(number.ToString());}

    num = numStore;
# ---------- c_script_4: C# additional code ----------
  double number = 0;
  List <double> numStore = new List<double>();
# ---------- end c_script_4 ----------
pl_12 = ConstructPlane(Origin=avr, XAxis=ln_28, YAxis=ln_27)
panel_33 = Panel(c_script_4.num)
amp_13 = Amplitude(Vector=ln_24, Amplitude=graft(c_script_4.num))

item_40 = ListItem(List=flatten(len_7), Index=0, Wrap=True)

ln_29 = Line(StartPoint=pt_10, EndPoint=pt_11)
move_24 = Move(Geometry=pt_11, Motion=ln_29)  # -> Geometry, Transform
ccx_12 = CurveCurve(CurveA=cir_2, CurveB=offset)  # -> Points, ParamsA, ParamsB
item_41 = ListItem(List=ccx_12.Points, Index=0, Wrap=True)  # -> flatten(Item), flatten(Item1)
ln_30 = Line(StartPoint=pt_11, EndPoint=item_41.Item)
ln_31 = Line(StartPoint=pt_11, EndPoint=move_24.Geometry)
ln_32 = Line(StartPoint=pt_11, EndPoint=item_41.Item1)
angle_3 = Angle(VectorA=ln_30, VectorB=ln_31)  # -> Angle, Reflex
angle_4 = Angle(VectorA=ln_32, VectorB=ln_31)  # -> Angle, Reflex
deg_5 = Degrees(Radians=angle_3.Angle)
deg_6 = Degrees(Radians=angle_4.Angle)
item_42 = ListItem(List=ln_31, Index=Slider(3, range=0..4), Wrap=True)
tan = Tangent(Value=degrees(deg_5))
entwine_15 = Entwine(Branch00=ln_30, Branch01=tan, FlattenInputs=True)
tan_2 = Tangent(Value=degrees(deg_6))
division_11 = Division(A=tan, B=tan_2)
panel_34 = Panel(deg_6)
panel_35 = Panel(deg_5)
addition_7 = Addition(A=division_11, B=1)
division_12 = Division(A="1", B=addition_7)
subtraction = Subtraction(A="1", B=division_12)
num = Number(division_12)
larger_5 = LargerThan(FirstNumber=tan, SecondNumber=tan_2)  # -> LargerThan, OrEqualTo

amp_14 = Amplitude(Vector=ln_26, Amplitude=expr("x/2", flatten(item_40)))
amp_15 = Amplitude(Vector=ln_25, Amplitude=expr("x/2", flatten(item_40)))
move_25 = Move(Geometry=pt_11, Motion=amp_14)  # -> Geometry, Transform
move_26 = Move(Geometry=pt_11, Motion=amp_15)  # -> Geometry, Transform
ln_33 = Line(StartPoint=move_25.Geometry, EndPoint=move_26.Geometry)

crv_37 = Curve(ln_33)
mp = Midpoint(Curve=crv_37)
eval_6 = EvaluateCurve(Curve=crv_37, Parameter=subtraction)  # -> Point, Tangent, Angle
eval_7 = EvaluateCurve(Curve=crv_37, Parameter=num)  # -> Point, Tangent, Angle
dispatch_18 = Dispatch(List=eval_6.Point, DispatchPattern=larger_5.OrEqualTo)  # -> ListA, ListB
dispatch_19 = Dispatch(List=eval_7.Point, DispatchPattern=larger_5.OrEqualTo)  # -> ListA, ListB
pt_12 = Point(dispatch_18.ListB)
pt_13 = Point(dispatch_19.ListA)
merge_11 = Merge(Data1=pt_13, Data2=pt_12)
pull_16 = PullPoint(Point=merge_11, Geometry=graft(mp), ClosestOnly=True)  # -> ClosestPoint, Distance
panel_36 = Panel(merge_11)
sort_15 = SortList(Keys=pull_16.Distance, ValuesA=merge_11)  # -> Keys, ValuesA
item_43 = ListItem(List=sort_15.ValuesA, Index=0, Wrap=True)  # -> flatten(Item)
ln_34 = Line(StartPoint=item_43, EndPoint=mp)
panel_37 = Panel(item_43)
move_27 = Move(Geometry=crv_37, Motion=ln_34)  # -> Geometry, Transform

# ---- group: 正常和阳角 - BoundingBox — 测Intersection
entwine_16 = Entwine(Branch00=flip.Curve, Branch01=offset, FlattenInputs=True)
flip_5 = FlipMatrix(Data=entwine_16)
item_44 = ListItem(List=flip_5, Index=0, Wrap=True)  # -> Item, Item1

# ----
move_28 = Move(Geometry=move_27.Geometry, Motion=amp_13)  # -> Geometry, Transform
ccx_13 = CurveCurve(CurveA=move_28.Geometry, CurveB=crv_21)  # -> Points, ParamsA, ParamsB
item_45 = ListItem(List=ccx_13.Points, Index=0, Wrap=True)
item_46 = ListItem(List=ccx_13.Points, Index="-1", Wrap=True)
pshift_6 = ShiftPaths(Data=item_45, Offset=-1)
pshift_7 = ShiftPaths(Data=item_46, Offset=-1)
flip_6 = FlipMatrix(Data=pshift_6)
flip_7 = FlipMatrix(Data=pshift_7)
pt_14 = Point(flip_6)
pt_15 = Point(flip_7)
pull_17 = PullPoint(Point=pt_14, Geometry=graft(mp), ClosestOnly=True)  # -> ClosestPoint, Distance
pull_18 = PullPoint(Point=pt_15, Geometry=graft(mp), ClosestOnly=True)  # -> ClosestPoint, Distance
sort_16 = SortList(Keys=pull_17.Distance, ValuesA=pt_14)  # -> Keys, ValuesA
sort_17 = SortList(Keys=pull_18.Distance, ValuesA=pt_15)  # -> Keys, ValuesA
item_47 = ListItem(List=sort_16.ValuesA, Index="-1", Wrap=True)
item_48 = ListItem(List=sort_17.ValuesA, Index="-1", Wrap=True)
ln_35 = Line(StartPoint=item_48, EndPoint=item_47)

end_9 = EndPoints(Curve=ln_35)  # -> Start, End

avr_2 = Average(Input=[end_9.Start, end_9.End])
pl_13 = ConstructPlane(Origin=avr_2, XAxis=ln_35, YAxis=graft(ln_24))
orient_10 = Orient(Geometry=graft(item_35), Source=pl_12, Target=pl_13)  # -> Geometry, Transform
orient_11 = Orient(Geometry=graft(item_34), Source=pl_12, Target=pl_13)  # -> Geometry, Transform

filter_20 = StreamFilter(Gate=list_8, Stream0=item_34, Stream1=orient_11.Geometry)

# ---- group: Monomer + Side/Top / Monomer Type (continued)
filter_21 = StreamFilter(Gate=list, Stream0=item_34, Stream1=filter_20, Stream2=item_34)

# ---- group: Monomer + Side/Top / Top/Side
filter_22 = StreamFilter(Gate=list_2, Stream0=filter_21, Stream1=filter_19)

# ----
filter_23 = StreamFilter(Gate=list_8, Stream0=item_35, Stream1=orient_10.Geometry)

# ---- group: 阳角分类
filter_24 = StreamFilter(Gate=list, Stream0=item_35, Stream1=filter_23, Stream2=item_35)
filter_25 = StreamFilter(Gate=list, Stream0=item_35, Stream1=item_35, Stream2=item_35)
filter_26 = StreamFilter(Gate=list_2, Stream0=filter_24, Stream1=filter_25)

# ----
阳角 = Geometry(filter_26)

# ---- group: 正常和阳角 - BoundingBox — 测Intersection (continued)
c_script_5 = CSharpScript(BrepMain=item_36, BrepStay=filter_22)  # -> out, BrepInters, BrepRemain, IndexM, IndexS; inputs BrepMain: list of Brep, BrepStay: list of Brep
# ---------- c_script_5: C# ----------
    List<Brep> BrepI = new List<Brep>();
    List<Brep> BrepR = new List<Brep>();
    List<int> num = new List<int>();
    List<int> numS = new List<int>();


    double tolr = Rhino.RhinoDoc.ActiveDoc.ModelAbsoluteTolerance;

    for(int j = 0; j < BrepMain.Count;j++){
      for(int i = 0; i < BrepStay.Count;i++){
        bool test = Rhino.Geometry.Intersect.Intersection.BrepBrep(BrepMain[j], BrepStay[i], tolr, out crv, out pts);
        if(test && crv.Length != 0){
          tryThis = true;
          numS.Add(i);
          break;}
        else{
          tryThis = false;}
      }
      if(tryThis){
        BrepI.Add(BrepMain[j]);
        num.Add(j);
      }
      else{
        BrepR.Add(BrepMain[j]);
      }
    }



    BrepInters = BrepI;
    BrepRemain = BrepR;
    IndexM = num;
    IndexS = numS;
# ---------- c_script_5: C# additional code ----------
  Rhino.Geometry.Curve[] crv;
  Rhino.Geometry.Point3d[] pts;
  bool tryThis;
# ---------- end c_script_5 ----------
item_49 = ListItem(List=item_36, Index=c_script_5.IndexM, Wrap=True)  # -> graft(Item)
item_50 = ListItem(List=filter_22, Index=c_script_5.IndexS, Wrap=True)  # -> graft(Item)
cull_i_12 = CullIndex(List=item_37, Indices=c_script_5.IndexM, Wrap=True)
item_51 = ListItem(List=item_37, Index=c_script_5.IndexM, Wrap=True)  # -> graft(Item)
area_14 = Area(Geometry=item_49)  # -> Area, Centroid
bbx = BrepBrep(BrepA=item_49, BrepB=item_50)  # -> simplify(Curves), Points
area_15 = Area(Geometry=bbx.Curves)  # -> Area, Centroid
ln_36 = Line(StartPoint=area_14.Centroid, EndPoint=area_15.Centroid)
mp_2 = Midpoint(Curve=ln_36)
scale_11 = Scale(Geometry=ln_36, Center=mp_2, Factor=Slider(1000000, range=0..1000000))  # -> Geometry, Transform
ccx_14 = CurveCurve(CurveA=scale_11.Geometry, CurveB=bbx.Curves)  # -> Points, ParamsA, ParamsB
item_52 = ListItem(List=ccx_14.Points, Index=0, Wrap=True)  # -> Item, Item1
ln_37 = Line(StartPoint=item_52.Item1, EndPoint=item_52.Item)
move_29 = Move(Geometry=item_51, Motion=ln_37)  # -> simplify(Geometry), Transform
bbox_10 = BoundingBox(Content=move_29.Geometry, Plane=PlaneXY(0, 0, 0))  # -> Box, Box_2

# ----
# 这里如果跑红也不要紧，
# 说明单体没有出现相撞的情况
area_16 = Area(Geometry=bbox_10.Box)  # -> Area, Centroid

# ---- group: 正常和阳角 - BoundingBox — 测Intersection (continued)
entwine_17 = Entwine(Branch00=move_29.Geometry, Branch01=area_16.Centroid, FlattenInputs=True)
flip_8 = FlipMatrix(Data=entwine_17)
item_53 = ListItem(List=flip_8, Index="0", Wrap=True)  # -> flatten(Item)
item_54 = ListItem(List=flip_8, Index="-1", Wrap=True)  # -> flatten(Item)
pull_19 = PullPoint(Point=item_54, Geometry=item_44.Item, ClosestOnly=True)  # -> flatten(ClosestPoint), Distance
pull_20 = PullPoint(Point=item_54, Geometry=item_44.Item1, ClosestOnly=True)  # -> flatten(ClosestPoint), Distance
vec2pt_5 = Vector2Pt(PointA=item_54, PointB=pull_19.ClosestPoint, Unitize=False)  # -> Vector, Length
vec2pt_6 = Vector2Pt(PointA=item_54, PointB=pull_20.ClosestPoint, Unitize=False)  # -> Vector, Length
multiplication_13 = Multiplication(A=vec2pt_5.Vector, B=vec2pt_6.Vector)
larger_6 = LargerThan(FirstNumber=multiplication_13, SecondNumber=0)  # -> LargerThan, OrEqualTo
dispatch_20 = Dispatch(List=item_53, DispatchPattern=larger_6.LargerThan)  # -> ListA, ListB

# ---- group: Normal
geo_7 = Geometry(cull_i_12)

# ---- group: Normal-Move
移动 = Geometry(dispatch_20.ListA)

# ----
# PLAN Results
merge_12 = Merge(Data1=geo_7, Data2=阳角, Data3=移动, Data4=阴角)

# ==== cluster Cluster
G = ClusterInput()
rotate = Rotate(Geometry=G, Angle=3.141592654, Plane=PlaneXY(0, 0, 0))  # -> Geometry, Transform
boxprop = BoxProperties(Box=rotate.Geometry)  # -> Center, Diagonal, Area, Volume, Degeneracy
bbox = BoundingBox(Content=rotate.Geometry, Plane=PlaneXY(0, 0, 0))  # -> Box, Box_2
debox = DeconstructBox(Box=bbox.Box)  # -> Plane, X, Y, Z
pdecon = Deconstruct(Point=boxprop.Center)  # -> XComponent, YComponent, ZComponent
dedomain = DeconstructDomain(Domain=debox.Y)  # -> Start, End
pt = ConstructPoint(XCoordinate=pdecon.XComponent, YCoordinate=dedomain.Start, ZCoordinate=pdecon.ZComponent)
xy = XYPlane(Origin=Point(0, 0, 0))
pl_origin = PlaneOrigin(Base=xy, Origin=pt)
orient = Orient(Geometry=rotate.Geometry, Source=pl_origin, Target=xy)  # -> Geometry, Transform
G_2 = ClusterOutput(orient.Geometry)
